# Dynamo graph 01_MovingSphere.dyn (Dynamo 1.3.0.875)

wpfState = CustomUINodeModelWpfState()  # "Essentials.CustomUI.WpfState"
watch = Watch(wpfState.out1)
number_slider = DoubleSlider(17.3, range=0..100 step 0.1)
watch_2 = Watch(wpfState.out0)
code_block = CodeBlock(r=number_slider, n=watch_2)
# ---------- code_block.designscript (4 lines) ----------
x = r * Math.Sin(n * 0.05 * 64);
y = r * Math.Cos(n * 0.05 * 64);
p = Autodesk.Point.ByCoordinates(x,y,0);
Sphere.ByCenterPointRadius(p,3);
# ----------------------------------------
