# Dynamo graph 03_SurfaceRotation.dyn (Dynamo 1.3.0.875)

rotate = Vector.Rotate()  # unwired: arg0, arg1
number_slider = DoubleSlider(93.3, range=0..100 step 0.1)
code_block = CodeBlock(z=number_slider)
# ---------- code_block.designscript (4 lines) ----------
{Point.ByCoordinates(0,0,z),
Point.ByCoordinates(0,100,0),
Point.ByCoordinates(100,100,z),
Point.ByCoordinates(100,0,0)};
# ----------------------------------------
byPerimeterPoints = Surface.ByPerimeterPoints(code_block)
number_slider_2 = DoubleSlider(36.3, range=0..100 step 0.1)
byCoordinates = Point.ByCoordinates(x=number_slider_2, y=number_slider_2)
ZAxis = Vector.ZAxis()
wpfState = CustomUINodeModelWpfState()  # "Essentials.CustomUI.WpfState"
rotate_2 = Geometry.Rotate(geometry=byPerimeterPoints, origin=byCoordinates, axis=ZAxis, degrees=wpfState)
