# Dynamo graph 02_Surface.dyn (Dynamo 1.3.0.875)

code_block = CodeBlock()
# ---------- code_block.designscript (4 lines) ----------
Autodesk.Point.ByCoordinates(0,0,0);
Autodesk.Point.ByCoordinates(100,0,0);
Autodesk.Point.ByCoordinates(0,100,0);
Autodesk.Point.ByCoordinates(100,100,0);
# ----------------------------------------
surfaceFrom4Points = Essentials.SurfaceFrom4Points(code_block.out0, code_block.out1, code_block.out2, code_block.out3)
identity = Object.Identity(surfaceFrom4Points)
integer_slider = IntegerSlider(10, range=0..100 step 1)
UVPlanesOnSurface = Essentials.UVPlanesOnSurface(surfaceFrom4Points, integer_slider, integer_slider)
identity_2 = Object.Identity(UVPlanesOnSurface)
